# Grasshopper definition GHDebugSurface.gh (Grasshopper 1.0.7)

# ---- group: SurfaceFrom4Points
srf4pt = _4PointSurface(CornerA="{0.0, 0.0, 0.0}", CornerB="{10.0, 0.0, 0.0}", CornerC="{10.0, 10.0, 2.0}", CornerD="{0.0, 10.0, 4.0}")  # -> reparameterize(Surface)

# ---- group: SurfaceFromAGridOfPoints
srf = Surface(reparameterize(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))
srfpt = SurfacePoints(Surface=srf)  # -> Points, Weights, Greville, UCount, VCount

# ----
edges = BrepEdges(Brep=srf)  # -> Naked, Interior, NonManifold
srfpt_2 = SurfacePoints(Surface=srf4pt)  # -> Points, Weights, Greville, UCount, VCount
panel = Panel(srfpt.Points)
panel_2 = Panel(srfpt.Weights)
panel_3 = Panel(srfpt_2.Points)
crv = Curve(reparameterize(<curve referenced from the Rhino model>))
# All these definitions were used to convalidate and developed the GeometrySharp surfaces tests.
crv_2 = Curve(reparameterize(<curve referenced from the Rhino model>))
crv_3 = Curve(reparameterize(<curve referenced from the Rhino model>))
crv_4 = Curve(reparameterize(<curve referenced from the Rhino model>))

# ---- group: Split
c_script = CSharpScript(srf=srf)  # -> out, bothSplits; inputs srf: Surface
# ---------- c_script: C# usings ----------
using System.Linq;
# ---------- c_script: C# ----------
    var split1 = srf.Split(1, 0.5);
    var srfs = split1.SelectMany(s => s.Split(0, 0.5)).ToList();
    bothSplits = srfs;
# ---------- end c_script ----------
c_script_2 = CSharpScript(srf=srf)  # -> out, surfsV, surfsU; inputs srf: Surface
# ---------- c_script_2: C# ----------
    surfsV = srf.Split(1, 0.5);
    surfsU = srf.Split(0, 0.5);
# ---------- end c_script_2 ----------
srfpt_3 = SurfacePoints(Surface=c_script.bothSplits)  # -> Points, Weights, Greville, UCount, VCount
srf_2 = Surface(reparameterize([c_script_2.surfsV, c_script_2.surfsU]))
srfpt_4 = SurfacePoints(Surface=c_script_2.surfsU)  # -> Points, Weights, Greville, UCount, VCount
srfpt_5 = SurfacePoints(Surface=c_script_2.surfsV)  # -> Points, Weights, Greville, UCount, VCount
panel_4 = Panel(srfpt_3.Points)
panel_5 = Panel(srfpt_5.Points)
panel_6 = Panel(srfpt_4.Points)
panel_7 = Panel(srfpt_5.UCount)
panel_8 = Panel(srfpt_5.VCount)
panel_9 = Panel(srfpt_4.UCount)
panel_10 = Panel(srfpt_4.VCount)
panel_11 = Panel(srfpt_3.Weights)
panel_12 = Panel(srfpt_4.Weights)
panel_13 = Panel(srfpt_5.Weights)
evalsrf = EvaluateSurface(Surface=reparameterize(c_script.bothSplits), Point="{0.5,0.5,0.0}")  # -> Point, Normal, UDirection, VDirection, Frame
evalsrf_2 = EvaluateSurface(Surface=srf_2, Point="{0.5,0.5,0.0}")  # -> Point, Normal, UDirection, VDirection, Frame
panel_14 = Panel(evalsrf.Point)
panel_15 = Panel(evalsrf_2.Point)

# ----
c_script_3 = CSharpScript(x=crv_3)  # -> out, A; inputs x: Curve
# ---------- c_script_3: C# ----------
    A = x.Degree;
# ---------- end c_script_3 ----------
cp = ControlPoints(Curve=crv)  # -> Points, Weights, Knots
c_script_4 = CSharpScript(x=crv_2)  # -> out, A; inputs x: Curve; same code as c_script_3
cp_2 = ControlPoints(Curve=crv_2)  # -> Points, Weights, Knots

# ---- group: PointAt and VectorAt
panel_16 = Panel("""{0.5,0.5,0.0}
{0.1,0.1,0.0}
{1,1,0.0}
{0.3,0.5,0.0}""")
evalsrf_3 = EvaluateSurface(Surface=srf, Point=panel_16)  # -> Point, Normal, UDirection, VDirection, Frame
panel_17 = Panel(evalsrf_3.VDirection)
panel_18 = Panel(evalsrf_3.Point)

# ---- group: RationalDerivatives
c_script_5 = CSharpScript(srf=srf)  # -> out, derv0, dervs; inputs srf: Surface
# ---------- c_script_5: C# ----------
    Point3d pt;
    Vector3d[] derivis;
    srf.Evaluate(0.3, 0.5, 1, out pt, out derivis);
    dervs = derivis;
    derv0 = pt;
# ---------- end c_script_5 ----------
panel_19 = Panel(c_script_5.derv0)
panel_20 = Panel(c_script_5.dervs)

# ----
c_script_6 = CSharpScript(x=crv_4)  # -> out, A; inputs x: Curve; same code as c_script_3
cp_3 = ControlPoints(Curve=crv_4)  # -> Points, Weights, Knots
panel_21 = Panel(c_script_3.A)
panel_22 = Panel(cp.Knots)
item = ListItem(List=c_script_5.dervs, Index=0, Wrap=True)
panel_23 = Panel(cp_2.Knots)
panel_24 = Panel(c_script_4.A)
panel_25 = Panel(c_script_6.A)
panel_26 = Panel(cp_3.Knots)
vdis = VectorDisplay(Anchor=c_script_5.derv0, Vector=item)
join = JoinCurves(Curves=[crv_3, crv_4, crv_2], Preserve=False)
c_script_7 = CSharpScript(x=join)  # -> out, A; inputs x: Curve; same code as c_script_3
cp_4 = ControlPoints(Curve=join)  # -> Points, Weights, Knots
panel_27 = Panel(c_script_7.A)
panel_28 = Panel(cp_4.Knots)

# ---- group: SurfaceIsocurve
c_script_8 = CSharpScript(srf=srf)  # -> out, isoV, isoU; inputs srf: Surface
# ---------- c_script_8: C# ----------
    isoV = srf.ToNurbsSurface().IsoCurve(1, 0.3);
    isoU = srf.ToNurbsSurface().IsoCurve(0, 0.3);
# ---------- end c_script_8 ----------
eval = EvaluateCurve(Curve=reparameterize(c_script_8.isoU), Parameter=0.5)  # -> Point, Tangent, Angle
cp_5 = ControlPoints(Curve=c_script_8.isoU)  # -> Points, Weights, Knots
cp_6 = ControlPoints(Curve=c_script_8.isoV)  # -> Points, Weights, Knots
panel_29 = Panel(cp_6.Points)
panel_30 = Panel(cp_6.Weights)
panel_31 = Panel(cp_5.Points)
panel_32 = Panel(cp_5.Weights)
panel_33 = Panel(eval.Point)

# ---- group: ClosestPt and ClosestParameters
panel_34 = Panel("""{2.5, 7, 5}
{2.5, 1.5, 2}
{9, 2.5, 1}
{5, 5, 1}""")
pt = Point(panel_34)
c_script_9 = CSharpScript(testPt=pt, srf=srf)  # -> out, pt, uv; inputs testPt: Point3d, srf: Surface
# ---------- c_script_9: C# ----------
    Point3d ptAt;
    Vector3d[] derivs;
    double u; double v;
    srf.ClosestPoint(testPt, out u, out v);
    uv = new string[]{u.ToString(), v.ToString()};
    srf.Evaluate(u, v, 1, out ptAt, out derivs);
    pt = ptAt;
# ---------- end c_script_9 ----------
panel_35 = Panel(c_script_9.pt)
panel_36 = Panel(c_script_9.uv)
